# Grasshopper definition deliberation_field.gh (Grasshopper 0.9.76)
# plug-ins: Python Interpreter

# instructions to visualize deliberation field:
# 
# (1) double click on the timer
# 
# (2) set reset toggle to True
# 
# (3) set reset toggle to False
panel = Panel("""Pedro Veloso

DELIBERATION FIELD

01/30/2017""")

# ---- group: BOUNDARY POINTS
# generates geometry of the boudnary and the points for the integration of the vector fields
number_slider = Slider(120, range=1..500)
number_slider_2 = Slider(47, range=1..2000)
cir = Circle(Plane=PlaneXY(0, 0, 0), Radius=number_slider_2)
circle = Circle(cir)
divide = DivideCurve(Curve=circle, Count=number_slider, Kinks=False)  # -> Points, Tangents, Parameters
pt = Point(flatten(divide.Points))

# ---- group: ex 3 back to AGENTS
# (2) set reset toggle to True
# 
# (3) set reset toggle to False
# runs the simulation of the boids
# (1) double click on the timer
n_boids = Slider(50, range=0..100)
reset = BooleanToggle(False)
circle_2 = Circle(cir)
timer = Timer(TimerInterval=20, Target=[boids, vcf])  # disabled
r = Number(number_slider_2)
boids = PythonScript(reset=reset, scale=Slider(1, range=0.01..1), n=n_boids, boundary=circle_2, radius=r)  # -> out, a, out_t, charges, vint, vali, vsep, vcoh, charges_2; inputs n: Int32, radius: Int32
# ---------- boids: Python ----------
import rhinoscriptsyntax as rs
import Rhino.Geometry as rg
import random
import time


def remap(value, old_start, old_end, new_start, new_end):
	return new_start + (value - old_start) * (new_end - new_start) / (old_end - old_start)
	
class Flock:
    def __init__(self, boundary, radius):
        self.boids = []
        self.boundary = boundary
        self.radius = radius
    def run(self):
        for b in self.boids:
            #Each Boid object must know about all the other
            #Boids therefore we input the boids list.
            b.flock(self.boids)
    def addInitBoid(self):
        vel, loc, charge = self.parameters()
        charge = random.uniform(-400, -100)
        b = Boid(vel, loc, self.boundary, self.radius, charge) #define the parameters for the boids
        self.boids.append(b)
    def addBoid(self):
        vel, loc, charge = self.parameters()
        b = Boid(vel, loc, self.boundary, self.radius, charge) #define the parameters for the boids
        self.boids.append(b)
    def display(self):
        pts = [] 
        for b in self.boids:
            pts.append(rg.Point3d(b.location.X, b.location.Y, b.location.Z))
        return pts
    def parameters(self):
        vel_x, vel_y, vel_z = random.uniform(0, 1 * scale), random.uniform(0, 1 * scale),0
        vel = rs.VectorCreate([vel_x, vel_y, vel_z], [0, 0, 0])
        loc_x, loc_y, loc_z = random.uniform(-10, 10), random.uniform(-10, 10), 0
        loc = rs.VectorCreate([loc_x, loc_y, loc_z], [0, 0, 0])
        charge = random.uniform(10, 100)
        if random.random() < .5: 
            charge *= -10
            print "DONSDOND"
        return vel, loc, charge

class Boid:
    def __init__(self, vel, loc, boundary, radius, charge):
        self.velocity = vel # is a vector
        self.max_vel = remap(abs(charge), 10, 1600, 2 * scale, 1 * scale)
        self.location = loc # is a point
        self.boundary = boundary
        self.radius = radius
        self.charge = charge
        self.int = rg.Vector3d(0, 0, 0)
        self.sep = rg.Vector3d(0, 0, 0)
        self.ali = rg.Vector3d(0, 0, 0)
        self.coh = rg.Vector3d(0, 0, 0)
        self.int = rg.Vector3d(0, 0, 0)
        self.other = rg.Point3d(10, 0, 0)
    def flock(self, boids):
        sep = self.separate(boids, DIST_SEP)
        ali = self.align(boids, DIST_ALI)
        coh = self.cohesion(boids, DIST_COH)
        int = self.inside()
        #Arbitrary weights for these forces
        sep = sep*WEIGHT_SEP
        ali = ali*WEIGHT_ALI
        coh = coh*WEIGHT_COH
        int = int*WEIGHT_INT
        #Applying all the forces
        temp = sep + ali + coh + int
        self.sep = sep
        self.ali = ali
        self.coh = coh
        self.int = int
        self.velocity += temp
        if rs.VectorLength(self.velocity) > self.max_vel:
            self.velocity = rs.VectorUnitize(self.velocity) * self.max_vel
        self.location += self.velocity
        

        
#    def boidDistance(self, other):
#        d = rs.Distance(self.location, other.location)
#        return d
    
    def separate(self, boids, DESIRED_SEPARATION):
        """ 
        Separation (also known as “avoidance”)
        Steer to avoid colliding with your neighbors.
        """
        force = rs.VectorCreate([0, 0, 0], [0, 0, 0])
        avg = rs.VectorCreate([0, 0, 0], [0, 0, 0])
        n = 0
        for b in boids:
            d = rs.Distance(self.location, b.location)
            if (d > 0) and (d < DESIRED_SEPARATION):
                self.other = b.location
                avg += b.location
                n += 1
        if n>0: 
            avg = avg / n
            force = rs.VectorCreate(self.location, avg)
            force = rs.VectorUnitize(force) * self.max_vel
        # Calculate vector STEERING TOWARDS the center of the flock
        # Limit to maximum steering force, make sure it won’t move too much away
        
        return force



    def align(self, boids, DESIRED_NEIGHBOR_DISTANCE):
        """
        Alignment(also known as “copy”)
        Steer in the same direction as your neighbors.
        """
        # for every boid in the system, check if it's too close
        vels = rs.VectorCreate([0, 0, 0], [0, 0, 0])
        n = 0
        for b in boids:
            d = rs.Distance(self.location, b.location)
            if (d > 0) and (d < DESIRED_NEIGHBOR_DISTANCE):
                vels += b.velocity
                n += 1
        if n>0: 
            vels = vels / n
            vels = rs.VectorUnitize(vels) * self.max_vel
        return vels

    def cohesion (self, boids, DESIRED_NEIGHBOR_DISTANCE):
        """# Cohesion (also known as “center”)"""
        # for every boid in the system, check if it's too close
        #avg = rs.AddPoint([0, 0, 0])
        force = rs.VectorCreate([0, 0, 0], [0, 0, 0])
        avg = rs.VectorCreate([0, 0, 0], [0, 0, 0])
        n = 0
        for b in boids:
            # calculate the distance
            d = rs.Distance(self.location, b.location)
            # checking the criteria
            if (d > 0) and (d < DESIRED_NEIGHBOR_DISTANCE):
                avg += b.location
                n += 1
        #GUID = GUID / int 
        if n>0: 
            avg = avg / n
            # Calculate vector STEERING TOWARDS the center of the flock
            force = rs.VectorCreate(avg, self.location)
            # Limit to maximum steering force, make sure it won’t move too much away
            force = rs.VectorUnitize(force) * self.max_vel
        return force

    def inside(self):
        rep = rs.VectorCreate([0, 0, 0], [0,0,0])
        d = rs.Distance(self.location, self.boundary.Center)
        if d > self.boundary.Radius: 
            rep = rs.VectorUnitize(rs.VectorCreate(self.boundary.Center, self.location)) * self.max_vel
        return rep
        
        



if reset:
    # initialize flock and populate it with voids
    flock = Flock(boundary, radius)
    flock.addInitBoid()
    flock.addInitBoid()
    cur_t = 1
    WEIGHT_SEP = .8
    WEIGHT_ALI = 0
    WEIGHT_COH = .1
    WEIGHT_INT = .3
    DIST_SEP = 15
    DIST_ALI = 10
    DIST_COH = 20
    mod1 = int(30/scale)
    mod2 = int(120/scale)
#    pts = flock.display() #take geometry to grasshopper
#    a = [rs.AddSphere(pt,5) for pt in pts]
    
else:
    #at each step of the animation
    if cur_t % mod1 == 0 :
        flock.addBoid()
    if cur_t % mod2 == 0 :
        WEIGHT_SEP = random.uniform(.5, 1.5)
        WEIGHT_ALI = random.uniform(0, .4)
        WEIGHT_COH = random.uniform(0, .5) 
        WEIGHT_INT = random.uniform(.01, .2) 
        DIST_SEP = random.uniform(2, 20)
        DIST_ALI = random.uniform(5, 15)
        DIST_COH = random.uniform(10, 30)
    flock.run()
    cur_t += 1
a = flock.display()
#vali = [b.ali for b in flock.boids]
#vsep = [b.sep for b in flock.boids]
#vcoh = [b.coh for b in flock.boids]
#vint = [b.int for b in flock.boids]
#others = [rs.AddLine(b.location, b.other) for b in flock.boids]
charges = [b.charge for b in flock.boids]
out_t = cur_t
print(cur_t)
# ---------- end boids ----------

# ----
pcharge = PointCharge(Point=boids.a, Charge=boids.charges_2, Decay=2)
panel_2 = Panel("charges the field")
mergef = MergeFields(Fields=pcharge)

pt_2 = Point(boids.a)
cir_2 = Circle(Plane=pt_2, Radius=0.2)

# ---- group: visualizing the field
# generate curves of the vector field
points_of_the_grid = Point(pt)
field = Field(mergef)
fline = FieldLine(Field=field, Point=points_of_the_grid, Steps=1000, Accuracy=0.1, Method=3)

# ---- group: evaluating the field
# displays the vectors at the points
points_of_the_grid_2 = Point(pt)  # disabled
field_2 = Field(mergef)  # disabled
evf = EvaluateField(Field=field_2, Point=points_of_the_grid_2)  # -> Tensor, Strength; disabled
vdisex = VectorDisplayEx(Point=points_of_the_grid_2, Vector=evf.Tensor, Colour=RGB(0, 0, 0), Width=2)  # disabled

# ---- group: Make a screen capture to file
# captures images for animation
panel_3 = Panel("C:\Users\Pedro\Documents\2018 Art + ML\A02\render\")  # disabled
number_slider_3 = Slider(1920, range=0..10000)  # disabled
number_slider_4 = Slider(1080, range=0..10000)  # disabled
openfile = BooleanToggle(False)  # disabled
capture = BooleanToggle(False)  # disabled
toggle = BooleanToggle(False)  # disabled
toggle_2 = BooleanToggle(False)  # disabled
toggle_3 = BooleanToggle(False)  # disabled
swatch = ColourSwatch(SwatchColor=RGB(255, 255, 255))  # disabled
vcf = ViewportCaptureToFile(
    reset=reset,
    cur_t=boids.out_t,
    capture=capture,
    Width=number_slider_3,
    Height=number_slider_4,
    BackgroundColor=swatch,
    Grid=toggle,
    WorldAxes=toggle_2,
    CPlaneAxes=toggle_3,
    OpenFile=openfile,
    FileName=panel_3)  # -> Path; inputs BackgroundColor: Color; disabled
# ---------- vcf: Python ----------
"""
Captures the Rhino viewport to an image file. Places the image in a folder called
Captures in the same directory as the GH definition. Names the image the same as 
the GH defintion followed by _hourMinuteSecond. Edit the script directly to set more options.
Note: Do not use this script with the GH button, freezes up the canvas for some reason.

    Inputs:
        Toggle: Activate the component using a boolean toggle. Do NOT use a Button {item,bool}
        BackgroundColor: Set the color of the Rhino viewport background {item,color,optional}
        Grid: Turn on the grid {item,bool,optional}
        WorldAxes:Turn on the world axes {item,bool,optional}
        CPlaneAxes: Turn on the cplane axes {item,bool,optional}
        OpenFile: If true the image will open in the default application {item,bool,optional}
    Outputs:
        Path: The path of the captured image {item,str}
    Remarks:
        Author: Anders Holden Deleuran
        License: Apache License 2.0
        Version: 160805
"""
ghenv.Component.Name = "ViewportCaptureToFile"
ghenv.Component.NickName ="VCF"
ghenv.Component.Category = "CM_FAHS"
ghenv.Component.SubCategory = "1 Automation"

import os
import datetime
import System
import scriptcontext as sc
import Rhino as rc

def checkOrMakeFolder():
    
    """ Check/makes a "Captures" folder in the GH def folder """
    
    if ghdoc.Path:
        folder = os.path.dirname(ghdoc.Path)
        captureFolder = folder + "\\Captures"
        if not os.path.isdir(captureFolder):
            os.makedirs(captureFolder)
        return captureFolder

def makeFileName():
    
    """ Make a string with the gh def name + current hourMinuteSecond """
    
    # Make hour minute seconds string
    n = datetime.datetime.now()
    ho,mt,sc = str(n.hour),str(n.minute),str(n.second)
    if len(ho) == 1:
        ho = "0"+ ho
    if len(mt) == 1:
        mt = "0"+mt
    if len(sc) == 1:
        sc = "0"+ sc
    hms = ho+mt+sc
    
    # Get name of GH def
    ghDef = ghenv.LocalScope.ghdoc.Name.strip("*")
    
    # Concatenate and return
    fileName = ghDef + "_" + hms
    
    return fileName

def captureActiveViewToFile(width,height,path,grid,worldAxes,cplaneAxes):
    
    """
    Captures the active view to an image file at the path. Path looks like this:
    "C:\\Users\\adel\\Desktop\\Captures\\foooo_112747.png"
    """
    
    # Set the script context to the current Rhino doc
    sc.doc = rc.RhinoDoc.ActiveDoc
    
    # Get the active view and set image dimensions
    activeView = sc.doc.Views.ActiveView
    imageDim = System.Drawing.Size(width,height)
    
    # Perform the capture
    try:
        imageCap = rc.Display.RhinoView.CaptureToBitmap(activeView,imageDim,grid,worldAxes,cplaneAxes)
        System.Drawing.Bitmap.Save(imageCap,path)
        rc.RhinoApp.WriteLine(path)
        return path
    except:
        raise Exception(" Capture failed, check the path")

# Set background color
#if BackgroundColor:
#    rc.ApplicationSettings.AppearanceSettings.ViewportBackgroundColor = BackgroundColor

# Capture
if reset:
    counter = 0
else:
    if capture and cur_t < 20000:
        if not Width:
            Width = 1920
        if not Height:
            Height = 1080
        capFolder = checkOrMakeFolder()
        if FileName:
            fileName = FileName
        else:
            fileName = makeFileName()
        try:
            path = os.path.join(capFolder,fileName + "{:04d}".format(cur_t) + ".png")
            Path = captureActiveViewToFile(Width,Height,path,Grid,WorldAxes,CPlaneAxes)
            if OpenFile:
                os.startfile(path)
        except:
            raise Exception(" Capture failed, save the GH definition")
        counter += 1
# ---------- end vcf ----------
panel_4 = Panel(vcf)  # disabled

# ----
# visualize vector field curves and agents
swatch_2 = ColourSwatch(SwatchColor=RGB(89, 20, 67))
preview = CustomPreview(Geometry=fline, Shader=ColourSwatch(SwatchColor=RGB(247, 116, 206)))
preview_2 = CustomPreview(Geometry=cir_2, Shader=swatch_2)
